# Grasshopper definition iaac_ws_test_2.gh (Grasshopper 1.0.7)
# plug-ins: Kangaroo2 Components

# ---- group: placeholder
srf = Surface(<surface referenced from the Rhino model>)

preview = CustomPreview(Geometry=srf, Material=ColourSwatch(SwatchColor=RGB(191, 115, 115)))

# ----
mesh = Mesh(<mesh referenced from the Rhino model>)
sframes = SurfaceFrames(Surface=srf, UCount=Slider(20, range=0..100), VCount=Slider(30, range=0..100))  # -> simplify(Frames), Parameters
cluster = Cluster(T_2=sframes.Frames, T=sframes.Frames, T_3=sframes.Frames)

# ---- group: placeholder / roug safety
item = ListItem(List=cluster, Index=0, Wrap=True)  # -> Item1, Item
pl_offset = PlaneOffset(BasePlane=item.Item1, Offset=expr("-x", "0.1"))
pl_offset_2 = PlaneOffset(BasePlane=item.Item, Offset=expr("-x", "0.1"))
merge = Merge(Data1=pl_offset_2, Data2=cluster, Data3=pl_offset)  # -> flatten(Result)

# ----
yz = YZPlane(Origin=merge)
dot = DotDisplay(Point=merge)
pline = PolyLine(Vertices=merge, Closed=False)
series = Series(Start=0, Step=1, Count=50)
item_2 = ListItem(List=merge, Index=series, Wrap=True)
viewer = ParamViewer(cluster)

# ----
# Robotic planning
button = Button()
ur10e = GhPythonScript(load=button)  # -> robot
# ---------- ur10e: Python ----------
import os

import compas_fab
from compas.artists import Artist
from compas.geometry import Frame
from compas.robots import RobotModel
from compas.robots.resources import LocalPackageMeshLoader
from compas_fab.backends import AnalyticalInverseKinematics
from compas_fab.backends import OffsetWristKinematics
from compas_fab.backends.interfaces import ClientInterface
from compas_fab.robots import Robot
from compas_fab.robots import RobotSemantics


canvas = ghenv.Component.OnPingDocument()

urdf_folder = os.path.join(os.path.dirname(canvas.FilePath), '../data/robots')
urdf_file = os.path.join(urdf_folder, 'ur10e.urdf')
srdf_file = os.path.join(urdf_folder, 'ur10e.srdf')

model = RobotModel.from_urdf_file(urdf_file)
model.load_geometry(LocalPackageMeshLoader(urdf_folder, 'ur_description'))

semantics = RobotSemantics.from_srdf_file(srdf_file, model)

client = ClientInterface()
client.is_connected = True
client.inverse_kinematics = AnalyticalInverseKinematics(solver='ur10e')

robot = Robot(model, client=client, semantics=semantics)
robot.artist = Artist(model)
# ---------- end ur10e ----------
pt = ConstructPoint(XCoordinate=Slider(0.3, range=0..1), YCoordinate=Slider(0, range=0..1), ZCoordinate=Slider(0.04, range=0..1))
tool_frame = ToolFrame(O=pt, C=pt)
cone = Mesh(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)
tool = COMPASFABAttachedTool(robot=ur10e, visual_mesh=mesh, tcf_plane=tool_frame)  # -> robot; inputs visual_mesh: Mesh, collision_mesh: Mesh
#   port visual_mesh: A visual mesh for the tool.
#   port collision_mesh: A collision mesh for the tool.
#   port tcf_plane: The frame of the tool in tool0 frame.
#   port group: The planning group to which the tool should be attached.
# ---------- tool: Python ----------
"""
Attach a tool to the robot.

COMPAS FAB v0.26.0
"""
from ghpythonlib.componentbase import executingcomponent as component
from compas_rhino.conversions import RhinoMesh
from compas_rhino.conversions import plane_to_compas_frame

from compas.geometry import Frame
from compas_fab.robots import Tool


class AttachToolComponent(component):
    def RunScript(self, robot, visual_mesh, collision_mesh, tcf_plane, group):
        if robot and robot.client and robot.client.is_connected and visual_mesh:
            if not collision_mesh:
                collision_mesh = visual_mesh

            c_visual_mesh = RhinoMesh.from_geometry(visual_mesh).to_compas()
            c_collision_mesh = RhinoMesh.from_geometry(collision_mesh).to_compas()

            if not tcf_plane:
                frame = Frame.worldXY()
            else:
                frame = plane_to_compas_frame(tcf_plane)
            tool = Tool(c_visual_mesh, frame, c_collision_mesh)

            robot.attach_tool(tool, group)

        return robot
# ---------- end tool ----------
toggle = BooleanToggle(False)

robot_ip = Panel("192.168.10.10")

move_to_config = GhPythonScript(send=Button(), ip=robot_ip)  # -> config
# ---------- move_to_config: Python ----------
__author__ = "kchadha"
__version__ = "2022.11.18"

import rhinoscriptsyntax as rs

import os
import math
from scriptcontext import sticky as st

from compas.rpc import Proxy
from compas_fab.ghpython.components import create_id

key = create_id(ghenv.Component, 'get_config')

if send:
    canvas = ghenv.Component.OnPingDocument()
    path = os.path.abspath(os.path.dirname(canvas.FilePath))
    rtde = Proxy('fabrication', path=path)
    nowait = False
    st[key] = rtde.get_config(ip=ip)
    ghenv.Component.Message = "Config received"

config = st.get(key)
# ---------- end move_to_config ----------
python = GhPythonScript(robot=tool, place_frames=item_2, start_config=move_to_config)  # -> out, place_configs; inputs place_frames: list
# ---------- python: Python ----------
__author__ = "kchadha"
__version__ = "2022.11.12"


import math
import rhinoscriptsyntax as rs
import compas_rhino.conversions as crc
#from compas_rhino.conversions import RhinoPlane
from compas_fab.backends import AnalyticalPlanCartesianMotion

if robot and robot.client:
    place_frames = [crc.plane_to_compas_frame(f) for f in place_frames]
    start_configuration = robot.zero_configuration()
    if start_config:
        start_configuration.joint_values = start_config.joint_values

    planner = AnalyticalPlanCartesianMotion(robot.client)
    trajectory = planner.plan_cartesian_motion(robot, place_frames, start_configuration, options={'keep_order': True})
    place_configs = trajectory.points
#    place_config = list(place_configs)[place_config_i]
    
#    place_config.joint_values[0] -= math.pi
#    configs = [place_config]
    place_config = place_configs[0]
    print ['{:.2f}'.format(math.degrees(r)) for r in place_config.joint_values]
#config = configs[x]
# ---------- end python ----------
panel = Panel(move_to_config)
item_3 = ListItem(List=python.place_configs, Index=Slider(0, range=0..50), Wrap=True)

robot_visualize = COMPASFABRobotVisualize(robot=tool, configuration=item_3, show_cm=toggle, show_acm=toggle)  # -> visual, collision, collision_meshes, attached_meshes, frames, base_frame, ee_frame; inputs show_visual: Boolean, show_collision: Boolean, show_frames: Boolean, show_base_frame: Boolean, show_end_effector_frame: Boolean, show_cm: Boolean, show_acm: Boolean
#   port group: The planning group used for end-effector and base visualization.
#   port configuration: The robot's full configuration.
#   port show_visual: Whether or not to show the robot's visual meshes.
#   port show_collision: Whether or not to show the robot's collision meshes.
#   port show_frames: Whether or not to show the robot's joint frames.
#   port show_base_frame: Whether or not to show the robot's base frame.
#   port show_end_effector_frame: Whether or not to show the robot's end-effector frame.
#   port show_cm: Whether or not to show the collision meshes (if any).
#   port show_acm: Whether or not to show the attached collision meshes (if any).
#   port visual: Rhino meshes of the robot's visual geometry (if any).
#   port collision: Rhino meshes of the robot's collision geometry (if any).
#   port collision_meshes: Rhino meshes of the scene's collision meshes (if any).
#   port attached_meshes: Rhino meshes of the scene's attached collision meshes (if any).
#   port frames: The robot's joint frames as Rhino planes (if any).
#   port base_frame: The robot's base frame as a Rhino plane (if any).
#   port ee_frame: The robot's end-effector frame as a Rhino plane (if any).
# ---------- robot_visualize: Python ----------
"""
Visualizes the robot.

COMPAS FAB v0.27.0
"""
from compas.artists import Artist
from compas.geometry import Frame
from compas.geometry import Transformation
from compas_fab.robots import PlanningScene
from ghpythonlib.componentbase import executingcomponent as component


class RobotVisualize(component):
    def RunScript(
        self,
        robot,
        group,
        configuration,
        show_visual,
        show_collision,
        show_frames,
        show_base_frame,
        show_end_effector_frame,
        show_cm,
        show_acm,
    ):

        visual = None
        collision = None
        collision_meshes = None
        attached_meshes = None
        frames = None
        base_frame = None
        ee_frame = None

        if robot:
            show_visual = True if show_visual is None else show_visual
            show_cm = True if show_cm is None else show_cm
            show_acm = True if show_acm is None else show_acm
            configuration = configuration or robot.zero_configuration()

            robot.update(configuration, visual=show_visual, collision=show_collision)
            compas_frames = robot.transformed_frames(configuration, group)

            if show_visual:
                visual = robot.artist.draw_visual()

            if show_collision:
                collision = robot.artist.draw_collision()

            if show_base_frame:
                base_compas_frame = compas_frames[0]
                artist = Artist(base_compas_frame)
                base_frame = artist.draw()

            if show_end_effector_frame:
                ee_compas_frame = robot.forward_kinematics(
                    configuration, group, options=dict(solver="model")
                )
                artist = Artist(ee_compas_frame)
                ee_frame = artist.draw()

            if show_frames:
                frames = []
                for compas_frame in compas_frames[1:]:
                    artist = Artist(compas_frame)
                    frame = artist.draw()
                    frames.append(frame)

            if show_cm or show_acm:
                scene = PlanningScene(robot)
                scene = robot.client.get_planning_scene()

                collision_meshes = []
                attached_meshes = []

                if show_cm:
                    for co in scene.world.collision_objects:
                        header = co.header
                        frame_id = header.frame_id
                        cms = co.to_collision_meshes()

                        for cm in cms:
                            if cm.frame != Frame.worldXY():
                                t = Transformation.from_frame(cm.frame)
                                mesh = cm.mesh.transformed(t)
                            else:
                                mesh = cm.mesh

                            collision_meshes.append(Artist(mesh).draw())

                if show_acm:
                    for aco in scene.robot_state.attached_collision_objects:
                        for acm in aco.to_attached_collision_meshes():
                            frame_id = aco.object["header"]["frame_id"]
                            frame = robot.forward_kinematics(
                                configuration, options=dict(link=frame_id)
                            )
                            t = Transformation.from_frame(frame)

                            # Local CM frame
                            if (
                                acm.collision_mesh.frame
                                and acm.collision_mesh.frame != Frame.worldXY()
                            ):
                                t = t * Transformation.from_frame(
                                    acm.collision_mesh.frame
                                )

                            mesh = acm.collision_mesh.mesh.transformed(t)

                            attached_meshes.append(Artist(mesh).draw())

        return (
            visual,
            collision,
            collision_meshes,
            attached_meshes,
            frames,
            base_frame,
            ee_frame,
        )
# ---------- end robot_visualize ----------

move_to_config_2 = GhPythonScript(
    config=python.place_configs,
    speed=Slider(0.1, range=0..2),
    accel=Slider(0.1, range=0..3.14),
    send=Button(),
    ip=robot_ip,
    blend=Slider(0.05, range=0..0.1))  # -> a; inputs config: list
# ---------- move_to_config_2: Python ----------
__author__ = "kchadha"
__version__ = "2022.11.18"


import os
import math

from compas.rpc import Proxy

if send:
    if not config:
        ghenv.Component.Message = "No config to move to!"
    else:
        canvas = ghenv.Component.OnPingDocument()
        path = os.path.abspath(os.path.dirname(canvas.FilePath))
        rtde = Proxy('fabrication', path=path)
        nowait = False
#        a = rtde.move_to_joints(config, speed, accel, nowait, ip=ip)
        a = rtde.move_trajectory(config,speed, accel, blend, ip=ip)
        ghenv.Component.Message = "Sent config"
# ---------- end move_to_config_2 ----------
panel_2 = Panel(move_to_config_2)

# ==== cluster ToolFrame
N = Factor(0.5)
O = ClusterInput()
pi = Pi(Factor=N)
Y = UnitY(Factor=1)
xy = XYPlane(Origin=O)
X = UnitX(Factor=1)
C = ClusterInput()
rot3d = Rotate3D(Geometry=xy, Angle=degrees(Slider(-90, range=-90..90)), Center=C, Axis=X)  # -> Geometry, Transform
G = ClusterOutput(rot3d.Geometry)

# ==== cluster Cluster
T = ClusterInput()
tstat = TreeStatistics(Tree=T)  # -> Paths, Length, Count
T_2 = ClusterInput()
T_3 = ClusterInput()
dispatch = Dispatch(List=tstat.Paths, DispatchPattern=[True, False])  # -> ListA, ListB
branch = TreeBranch(Tree=T_2, Path=dispatch.ListA, MaintainPaths=True)
branch_2 = TreeBranch(Tree=T_3, Path=dispatch.ListB, MaintainPaths=True)
rev = ReverseList(List=branch_2)
data = Data(branch)
data_2 = Data(rev)
path_mapper = PathMapper(data_2, source="{A}", target="{A;+1}")
viewer = ParamViewer(data)
viewer_2 = ParamViewer(path_mapper)
weave = Weave(Pattern=[0, 1], Stream0=viewer, Stream1=viewer_2, NullGaps=False)
branch_3 = TreeBranch(Tree=[data, path_mapper], Path=weave, MaintainPaths=False)
B = ClusterOutput(branch_3)
